% Simulink data dictionary MVEPP_DataDict.sldd

vent_mode_def_t = enum(DefaultValue="MODE_UNCHANGED")  % 通气模式枚举定义
  MODE_UNCHANGED = 0
  MODE_MANUAL = 1  % 手动模式【麻醉机】
  MODE_VCV = 2  % 容量控制通气
  MODE_PCV = 3  % 压力控制通气
  MODE_PCV_VG = 4  % 压力保证容量控制通气
  MODE_SIMV_VC = 5  % 同步间歇指令VC通气
  MODE_SIMV_PC = 6  % 同步间歇指令PC通气
  MODE_SIMV_VG = 7  % 同步间歇指令VG通气
  MODE_PSV = 8  % 压力辅助通气
  MODE_VSV = 9  % 容量支持通气
  MODE_BIVENT = 10  % 双水平气道正压通气
  MODE_APRV = 11  % 气道压力释放通气
  MODE_ASV = 12  % 适宜性支持通气
  MODE_IPV = 13  % 智能比例辅助通气
  MODE_SI = 14
  MODE_PV = 15
  MODE_CPRV_AUTO = 16  % 心肺复苏通气
  MODE_CPRV_PRESS = 17  % 心肺复苏通气（按压）
  MODE_APNEA = 18  % 窒息通气
  MODE_TRANSPORT = 19  % 急救转运
  MODE_HFNC = 20  % 经鼻高流量湿化
  MODE_NIV_PCV = 21  % 无创压力控制通气NIV/PCV【呼吸机无创应用】
  MODE_NIV_CPAP = 22  % 持续气道正压通气CPAP【呼吸机无创应用】
  MODE_NIV_S = 23
  MODE_NIV_T = 24  % 无创时间通气NIV/T【呼吸机无创应用】
  MODE_NIV_ST = 25  % 无创自主/时间切换通气NIV/S/T【呼吸机无创应用】
  MODE_NIV_VGPS = 26  % 无创容量保证支持通气模式NIV/VGPS【呼吸机无创应用】
  MODE_nCPAP = 27  % 经鼻持续气道正压【呼吸机无创新生儿】
  MODE_nIPPV = 28  % 经鼻间歇正压通气【呼吸机无创新生儿】
  MODE_nSIPPV = 29  % 经鼻间歇正压通气【呼吸机无创新生儿】
  MODE_UNDEFINED = 30

trigger_type_t = enum()  % 自主触发类型
  TRIGGER_PRESS = 0  % 压力触发
  TRIGGER_FLOW = 1  % 流量触发

patient_type_t = enum()  % 患者类型枚举定义
  PATIENT_ADULT = 0  % 成人患者
  PATIENT_CHILD = 1  % 儿童患者（3-12岁）
  PATIENT_INFANT = 2  % 婴幼儿患者（3岁以内）
  PATIENT_NEWBORN = 3  % 新生儿/早产儿患者（0-28天）

patient_gender_t = enum()  % 性别类型枚举定义
  PATIENT_MALE = 0  % 男性患者
  PATIENT_FEMALE = 1  % 女性患者

vent_type_t = enum()  % 通气模式类别
  VENT_TYPE_CTR = 0  % 控制通气模式
  VENT_TYPE_ASSIST = 1  % 辅助通气模式
  VENT_TYPE_SUPPORT = 2  % 支持通气模式

arti_tube_type_t = enum()  % 插管类型枚举定义
  INVASIVE = 0  % 无创
  TRACH = 1  % 气管切开插管
  ET = 2  % 气管导管

cycle_type_t = enum()  % 触发类型枚举定义
  NO_TRIG = 0  % 未触发
  TRIG_MACHINE = 1  % 机控触发
  TRIG_SPONT = 2  % 自主呼吸触发

vcv_wave_t = enum(DefaultValue="WAVE_SQUARE")  % VCV模式流量波形
  WAVE_SQUARE = 0  % 方波
  WAVE_TRIANG = 1  % 三角波
  WAVE_TRAPE = 2  % 梯形波
  WAVE_SINE = 3  % 正弦波

ctrl_set_t = Simulink.Bus()
  Enable: uint8

efm_moni_t = Simulink.Bus()  % 流量计实时数据
  EFMO2: single  % 氧气流量
  EFMAir: single  % 空气流量
  EFMN2O: single  % 笑气流量
  FIO2: single  % 氧浓度
  Total: single  % 总流量

insp_end_para_t = Simulink.Bus()
  Ppeak: single, Min=-500, Max=1500, Unit="hPa"  % 压力
    % 气道峰压
  Pplat: single, Min=-500, Max=1500, Unit="hPa"  % 压力
    % 吸气末正压（平台压）
  Vti: single, Min=0, Max=6000, Unit="mL"  % 容量
    % 吸入潮气量
  MVi: single, Min=0, Max=100, Unit="L/min"  % 容量
    % （吸气）分钟通气量
  InspFpeak: single, Min=0, Max=300, Unit="L/min"  % 流量
    % 吸气峰值流量
  Ti: uint32, Min=0, Max=30000, Unit="ms"  % 时间
    % 吸气时间
  TiSpont: uint32, Min=0, Max=30000, Unit="ms"
  Oxy: single, Min=0, Max=100, Unit="%"  % 氧浓度值

mech_param_t = Simulink.Bus()  % 患者的呼吸力学结构参数【数值模型设置】
  Crs: uint16, Unit="mL/hPa"  % 顺应性设置
  Rrs: uint16, Unit="hPa/(L/s)"  % 气阻设置

vent_timer_t = Simulink.Bus()  % 通气时钟结构体定义
  CurCycle: uint32, Unit="1"  % 当前通气周期计数
  CurTime: uint32, Unit="ms"  % 当前通气周期时间
  InspTime: uint32, Unit="ms"  % 当前通气周期吸气时间
  ExpTime: uint32, Unit="ms"  % 当前通气周期呼气时间
  InspHoldTime: uint32, Unit="ms"  % 当前通气周期吸气保持时间
  ExpHoldTime: uint32, Unit="ms"  % 当前通气周期呼气保持时间
  VentFlag: Enum: vent_state_def_t  % 呼吸相位

alm_set_t = Simulink.Bus()
  Param: Bus: alm_param_t
  Switch: Bus: alm_switch_t  % 报警限值开关

patient_set_t = Simulink.Bus()
  MechParam: Bus: mech_param_t
  BreathParam: Bus: breath_param_t

patient_param_t = Simulink.Bus()
  Type: Enum: patient_type_t  % 患者类型
  Weight: uint16, Unit="kg"  % 患者体重
  Height: uint16, Unit="cm"  % 患者身高
  Age: uint16  % 患者年龄
  IBW: single, Unit="kg"  % 理想体重
  Gender: Enum: patient_gender_t  % 患者性别

breath_param_t = Simulink.Bus()  % 患者的自主呼吸参数
  BR: uint16, Unit="1/min"  % 呼吸频率【模拟患者自主呼吸设置】
  Increase: uint16, Min=0, Max=100, Unit="%"  % 吸气用力增加时间【模拟患者自主呼吸设置】
  Hold: uint16, Min=0, Max=100, Unit="%"  % 吸气用力保持时间【模拟患者自主呼吸设置】
  Release: uint16, Min=0, Max=100, Unit="%"  % 吸气用力释放时间【模拟患者自主呼吸设置】
  Pause: uint16, Min=0, Max=100, Unit="%"  % 吸转呼暂停时间【模拟患者自主呼吸设置】
  ExpIncrease: uint16, Min=0, Max=100, Unit="%"  % 呼气用力增加时间【模拟患者自主呼吸设置】
  ExpHold: uint16, Min=0, Max=100, Unit="%"  % 呼气用力保持时间【模拟患者自主呼吸设置】
  ExpRelease: uint16, Min=0, Max=100, Unit="%"  % 呼气用力释放时间【模拟患者自主呼吸设置】
  Pmax: uint16, Min=0, Max=50, Unit="hPa"  % 吸气最大用力【模拟患者自主呼吸设置】
  ExpPmax: uint16, Min=0, Max=50, Unit="hPa"  % 呼气最大用力【模拟患者自主呼吸设置】

ctrl_data_t = Simulink.Bus()  % 作动器件控制量
  InspValveCmd: single, Min=0, Max=100, Unit="%"  % 吸气阀控制量
  ExpValveCmd: single, Min=0, Max=100, Unit="%"  % 呼气阀控制量
  TurboCmd: single, Min=0, Max=100, Unit="%"  % 涡轮控制量
  OxyValveCmd: single, Min=0, Max=100, Unit="%"  % 氧气阀控制量

env_data_t = Simulink.Bus()
  Elevation: int16, Unit="m"  % 海拔高度

monitor_data_t = Simulink.Bus()  % 监测数据
  Ppeak: single, Min=-50, Max=150, Unit="hPa"  % 压力
    % 气道峰压
  Pplat: single, Min=-50, Max=150, Unit="hPa"  % 压力
    % 吸气末正压（平台压）
  Peep: single, Min=0, Max=150, Unit="hPa"  % 压力
    % 呼气末正压
  Pmean: single, Min=0, Max=150, Unit="hPa"  % 压力
    % 平均气道压
  Pdriver: single, Min=0, Max=150, Unit="hPa"  % 压力
    % 驱动压
    % 平台压力Pplat减去呼气末正压Peep
  Pmin: single, Min=0, Max=150, Unit="hPa"  % 压力
    % 最小压力
  InspFpeak: single, Min=0, Max=300, Unit="L/min"  % 流量
    % 吸气峰值流量
  ExpFpeak: single, Min=0, Max=300, Unit="L/min"  % 流量
    % 呼气峰值流速
  Vti: single, Min=0, Max=6000, Unit="mL"  % 容量
    % 吸入潮气量
  Vte: single, Min=0, Max=6000, Unit="mL"  % 容量
    % 呼气潮气量
  VT: single, Min=0, Max=6000, Unit="mL"  % 容量波形绘制参数
  VteSpont: single, Min=0, Max=6000  % 触发通气的呼气潮气量
  MVi: single, Min=0, Max=100, Unit="L/min"  % 容量
    % （吸气）分钟通气量
  MVe: single, Min=0, Max=100, Unit="L/min"  % 容量
    % （呼气）分钟通气量
  MVeSpont: single, Min=0, Max=100, Unit="L/min"  % 容量
    % 自主呼吸分钟通气量
  LeakVolume: single
  LeakPercent: single
  Ti: uint32, Min=0, Max=30000, Unit="ms"  % 时间
    % 吸气时间
  Te: uint32, Min=0, Max=30000, Unit="ms"  % 时间
    % 呼气时间
  TiSpont: uint32, Min=0, Max=30000, Unit="ms"  % 时间
    % 自主吸气时间
  Ftotal: single, Min=0, Max=200, Unit="1/min"  % 时间
    % 总呼吸频率
  Fspont: single, Min=0, Max=200, Unit="1/min"  % 时间
    % 自主呼吸频率
  FspontPercent: single, Min=0, Max=100, Unit="%"  % 时间
    % 自主呼吸次数/总呼吸次数
  Oxy: single, Min=0, Max=100, Unit="%"  % 氧浓度值
  Rinsp: single, Min=0, Max=600, Unit="hPa/(L/s)"  % 呼吸系统力学参数
    % 气道吸气阻力
    % 命名：Rinsp
    % 精度：保证读数的±20%或±10cmH2O/(L/s)，取大值
    % 计算方法：Rinsp  = (Ppeak - Pplat) / InspFpeak
  Rexp: single, Min=0, Max=600, Unit="hPa/(L/s)"  % 呼吸系统力学参数
    % 气道呼气阻力
    % 命名：Rexp
    % 精度：保证读数的±20%或±10cmH2O/(L/s)，取大值
    % 计算方法：Rexp  = ( Pplat - Peep) / ExpFpeak
  CStatic: single, Min=0, Max=300, Unit="mL/hPa"  % 呼吸系统力学参数
    % 静态顺应性
    % 命名：Cstatic
    % 精度：保证读数的±20%或±10 ml/cmH2O，取大值
    % 计算方法：Cstatic = Vti / (Pplat - Peep)
  CDynamic: single, Min=0, Max=300, Unit="mL/hPa"  % 呼吸系统力学参数
    % 动态顺应性
    % 命名：Cdyn
    % 精度：保证读数的±20%或±10 ml/cmH2O，取大值
    % 计算方法：Cdyn = Vti / (Ppeak-PEEP)
  Elastance: single, Min=0, Max=99, Unit="hPa/L"  % 呼吸系统力学参数
    % 弹性阻力
    % 命名：Elastance
    % 精度：保证读数的±10%或±5 cmH2O/L，取大值
    % 计算方法：Elastance = 1 / Cstatic
  Tci: single, Min=0, Max=9999, Unit="ms"  % 呼吸系统力学参数
    % 吸气时间常数
  Tce: single, Min=0, Max=9999, Unit="ms"  % 呼吸系统力学参数
    % 呼气时间常数
  WOB: single, Min=0, Max=100, Unit="J/L"  % 呼吸系统力学参数
    % 呼吸功
    % 命名：WOB
    % 精度：保证读数的±20%或±2J/L，取大值
    % 计算方法：吸气过程呼吸功 = 胸腔压力的变化(△P) × 肺容量的变化(△V)
  RSBI: single, Min=0, Max=9999, Unit="(1/min)/L"  % 呼吸系统力学参数
    % 浅快呼吸指数
    % 命名：RSBI
    % 精度：保证读数的±20%或±5bpm/L，取大值
    % 计算方法：RSBI= Fspont / Vte
  StressIndex: single, Min=0.1, Max=5, Unit="1"  % 呼吸系统力学参数
    % 浅快呼吸指数
    % 命名：SI
    % 精度：保证读数的±20%或±，取大值
    % 计算方法：吸气流速恒定，监测压力-时间曲线。P=a*timeb+c。A表示吸气曲线的斜率，c表示吸气开始时的气道压力，b为牵张指数。
  C20C: single, Min=0, Max=20, Unit="1"  % 呼吸系统力学参数
    % 肺过渡膨胀系数
    % 命名：C20C
    % 精度：±0.2或±10%，取大值
    % 计算方法：PV曲线中，峰值压力80%起始到峰值压力区间的顺应性值与动态顺应性的比值。
  CycleMode: uint32, Min=0  % 某通气模式的运行周期数
  CycleSpont: uint32, Min=0  % 触发通气的周期数
  LastVentType: Enum: vent_type_t  % 上个通气周期的通气类型

DefaultModelConfig_Ts = Simulink.ConfigSet(StartTime="0", StopTime="inf", FixedStep="double(Ts)/1000", Solver="FixedStepDiscrete", ProdHWDeviceType="ARM Compatible->ARM Cortex-M", SystemTargetFile="ert.tlc", TargetLang="C")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

sys_mode_def_t = enum(DefaultValue="STAND_BY")  % 系统运行模式
  STAND_BY = 0  % 待机
  VENT_ON = 1  % 通气
  CALI = 2  % 标校
  SELF_TEST = 3  % 自检

vent_status_t = Simulink.Bus()
  SysMode: Enum: sys_mode_def_t
  ModeName: Enum: vent_mode_def_t
  VentState: Enum: vent_state_def_t

alm_status_t = Simulink.Bus()  % 报警状态参数
  AH_CONT_PAW_HIGH: boolean  % 【高级报警】气道压力持续高
  AH_PAW_HIGH: boolean  % 【高级报警】气道压力高
  AH_PAW_LOW: boolean  % 【高级报警】气道压力低
  AH_PEEP_HIGH: boolean  % 【高级报警】呼气末正压高
  AH_PEEP_LOW: boolean  % 【高级报警】呼气末正压低
  AH_HIGH_VT_BYPMIN: boolean  % 【高级报警】目标潮气量高
  AH_LOW_VT_BYPMAX: boolean  % 【高级报警】目标潮气量低
  AH_VTE_HIGH: boolean  % 【高级报警】呼气潮气量高
  AH_VTE_LOW: boolean  % 【高级报警】呼气潮气量低
  AH_VTI_HIGH: boolean  % 【高级报警】吸气潮气量高
  AH_APNEA: boolean  % 【高级报警】窒息
  AM_SPON_FREQ_HIGH: boolean  % 【中级报警】自主呼吸频率高
  AM_SPON_FREQ_LOW: boolean  % 【中级报警】自主呼吸频率低
  AM_MV_HIGH: boolean  % 【中级报警】分钟通气量高
  AM_MV_LOW: boolean  % 【中级报警】分钟通气量低
  AM_SPON_TI_LONG: boolean  % 【中级报警】自主吸气时间过长
  AM_OXY_HIGH: boolean  % 【中级报警】氧浓度高
  AM_OXY_LOW: boolean  % 【中级报警】氧浓度低
  AL_PAW_HIGH: boolean  % 【低级报警】气道压力高

alm_switch_t = Simulink.Bus()
  PlimitH: boolean  % 气道压力上限
  PlimitL: boolean  % 气道压力下限
  PeepH: boolean  % 呼气末正压上限
  PeepL: boolean  % 呼气末正压下限
  fspontH: boolean  % 自主呼吸频率上限
  fspontL: boolean  % 自主呼吸频率下限
  MveH: boolean  % 分钟通气量上限
  MveL: boolean  % 分钟通气量下限
  VteH: boolean  % 呼气潮气量上限
  VteL: boolean  % 呼气潮气量下限
  VtiH: boolean  % 吸气潮气量上限
  OxyH: boolean  % 吸入氧浓度上限
  OxyL: boolean  % 吸入氧浓度下限
  Tapnea: boolean  % 窒息时间

alm_param_t = Simulink.Bus()  % 报警设置参数
  PlimitH: uint16, Min=5, Max=110, Unit="hPa"  % 气道压力上限
  PlimitL: uint16, Min=1, Max=90, Unit="hPa"  % 气道压力下限
  PeepH: uint16, Min=2, Max=50, Unit="hPa"  % 呼气末正压上限
  PeepL: uint16, Min=1, Max=49, Unit="hPa"  % 呼气末正压下限
  fspontH: uint16, Min=10, Max=150, Unit="1/min"  % 自主呼吸频率上限
  fspontL: uint16, Min=1, Max=80, Unit="1/min"  % 自主呼吸频率下限
  MveH: uint16, Min=20, Max=1000, Unit="dL/min"  % 分钟通气量上限
  MveL: uint16, Min=10, Max=400, Unit="dL/min"  % 分钟通气量下限
  VteH: uint16, Min=100, Max=4500, Unit="mL"  % 呼气潮气量上限
  VteL: uint16, Min=30, Max=1500, Unit="mL"  % 呼气潮气量下限
  VtiH: uint16, Min=100, Max=4500, Unit="mL"  % 吸气潮气量上限
  OxyH: uint16, Min=22, Max=100, Unit="%"  % 吸入氧浓度上限
  OxyL: uint16, Min=21, Max=99, Unit="%"  % 吸入氧浓度下限
  Tapnea: uint16, Min=10, Max=60, Unit="s"  % 窒息时间

mode_set_t = Simulink.Bus()
  SysMode: Enum: sys_mode_def_t  % 系统运行模式
  Patient: Bus: patient_param_t
  Name: Enum: vent_mode_def_t
  Param: Bus: vent_set_param_t
  Change: uint32
  SubFuncParam: Bus: sub_func_param_t

sub_func_param_t = Simulink.Bus()  % 辅助功能参数
  CC: boolean  % 顺应性补偿开关
  TubeID: uint16, Min=50, Max=120  % 导管内径（0.1mm）
  Comp: uint16, Min=1, Max=100, Unit="%"  % 导管补偿系数
  GasCond: uint16  % 0:ATP，1:ATPS，2:STP，3:STPD，4:BTPS
  TubeType: uint16  % 0:ET，1:TRACH，2:INVASIVE

sensor_data_t = Simulink.Bus()  % 传感器物理量
  AtomPress: single, Min=0, Max=1100, Unit="hPa"  % 【传感器解算物理量】环境温度
  AlvPress: single, Min=-100, Max=150, Unit="hPa"  % 【仿真物理量】肺内压
  MusPress: single, Min=-100, Max=150, Unit="hPa"  % 【仿真物理量】自主呼吸等效作用力
  InspFlow: single, Min=0, Max=300, Unit="L/min"  % 【传感器解算物理量】吸气支流量
  ExpFlow: single, Min=-20, Max=250, Unit="L/min"  % 【传感器解算物理量】呼气支流量
  NearFlow: single, Min=-250, Max=250, Unit="L/min"  % 【传感器解算物理量】近端流量
  InspPaw: single, Min=-100, Max=150, Unit="hPa"  % 【传感器解算物理量】吸气压力
  ExpPaw: single, Min=-100, Max=150, Unit="hPa"  % 【传感器解算物理量】呼气压力
  OXY: single, Min=0, Max=1000, Unit="m"  % 【传感器解算物理量】氧气浓度
  OxyFlow: single, Min=0, Max=300, Unit="L/min"  % 【传感器解算物理量】氧气流量
  OxySourcePress: single, Unit="hPa"  % 【传感器解算物理量】氧气源压力
  DrivePress: single, Min=-100, Max=150, Unit="hPa"  % 【传感器解算物理量】涡轮压力
  ReflectorFlow: single, Min=-250, Max=250, Unit="L/min"  % 【传感器解算物理量】盘管流量
  Temp: single, Min=-40, Max=50, Unit="°C"  % 【传感器解算物理量】环境温度

platform_t = enum(DefaultValue="Numer")
  Numer = 0
  DesktopRealTime = 1

LPM_TO_LPS = Simulink.Parameter(60, DataType="single")
Tc = Simulink.Parameter(2, StorageClass="Const", DataType="uint16", Unit="ms")  % 仿真步长
Ts = Simulink.Parameter(1, StorageClass="Const", DataType="uint16", Unit="ms")  % 仿真步长

sensor_sig_t = Simulink.Bus()  % 传感器原始电压值
  AtomPress: double, Min=0, Max=5, Unit="V"  % 【模拟电压】环境压传感器
  InspFlow: double, Min=0, Max=5, Unit="V"  % 【模拟电压】吸气流量传感器
  ExpFlow: double, Min=0, Max=5, Unit="V"  % 【模拟电压】环呼气流量传感器
  InspPaw: double, Min=0, Max=5, Unit="V"  % 【模拟电压】吸气压力传感器
  ExpPaw: double, Min=0, Max=5, Unit="V"  % 【模拟电压】呼气压力传感器
  OXY: double, Min=0, Max=5, Unit="V"  % 【模拟电压】氧电池
  OxyFlow: double, Min=0, Max=5, Unit="V"  % 【模拟电压】氧气流量传感器
  OxySourcePress: double, Min=0, Max=5, Unit="V"  % 【模拟电压】氧气源压力
  DrivePress: double, Min=0, Max=5, Unit="V"  % 【模拟电压】涡轮压力传感器
  Temp: double, Min=0, Max=5, Unit="V"  % 【模拟电压】温度传感器

vent_state_def_t = enum(DefaultValue="NULL_PHASE")  % 呼吸相位枚举定义
  NULL_PHASE = 0  % 空相位
  INSP_START = 1  % （机控）吸气开始
  INSP_PHASE = 2  % （机控）吸气中
  INSP_PHASE_SPONT = 3  % 自主吸气中
  INSP_HOLD = 4  % 吸气保持
  EXP_START = 16  % 呼气开始
  EXP_PHASE = 17  % 呼气中
  EXP_HOLD = 18  % 呼气保持

DefaultModelConfig_Tc = Simulink.ConfigSet(StartTime="0", StopTime="10", FixedStep="double(Tc)/1000", Solver="FixedStepDiscrete", ProdHWDeviceType="ARM Compatible->ARM Cortex-M", SystemTargetFile="ert.tlc", TargetLang="C")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
PER_TO_MILLI = Simulink.Parameter(10)
MIN_TO_S = Simulink.Parameter(60, DataType="single")
TO_MILLI = Simulink.Parameter(1000)
Ctrl_to_V = Simulink.Parameter(0.05, DataType="single")
Ctrl_to_mV = Simulink.Parameter(50, DataType="single")
TO_PER = Simulink.Parameter(100)
CtrlVar = Simulink.VariantControl(Value=0, ActivationTime="update diagram", ValueType="Numeric")

RunMode = Simulink.VariantConfigurationData(
  struct(
    Configurations=[struct(
      Name="ert",
      Description="",
      ControlVariables=struct(
        Name="Platform",
        Value=Simulink.VariantControl(Value=platform_t.Numer, ActivationTime="update diagram", ValueType="Numeric"),
        Source="MVEPP_DataDict.sldd")), struct(
      Name="sldrt",
      Description="",
      ControlVariables=struct(
        Name="Platform",
        Value=Simulink.VariantControl(
          Value=platform_t.DesktopRealTime,
          ActivationTime="update diagram",
          ValueType="Numeric"),
        Source="MVEPP_DataDict.sldd"))],
    VariantConfigurations=[struct(
      Name="ert",
      Description="",
      ControlVariables=struct(
        Name="Platform",
        Value=Simulink.VariantControl(Value=platform_t.Numer, ActivationTime="update diagram", ValueType="Numeric"),
        Source="MVEPP_DataDict.sldd"),
      SubModelConfigurations=[]), struct(
      Name="sldrt",
      Description="",
      ControlVariables=struct(
        Name="Platform",
        Value=Simulink.VariantControl(
          Value=platform_t.DesktopRealTime,
          ActivationTime="update diagram",
          ValueType="Numeric"),
        Source="MVEPP_DataDict.sldd"),
      SubModelConfigurations=[])],
    Constraints=[],
    PreferredConfiguration="ert",
    DefaultConfigurationName="",
    DataDictionaryName="MVEPP_DataDict.sldd",
    DataDictionarySection="Configurations",
    AreSubModelConfigurationsMigrated=true))

Platform = Simulink.VariantControl(
  Value=platform_t.DesktopRealTime,
  ActivationTime="update diagram",
  ValueType="Numeric")

config_Ts = Simulink.ConfigSetRef()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
config_Tc = Simulink.ConfigSetRef()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
SldrtModelConfig_Ts = Simulink.ConfigSet(StartTime="0", StopTime="inf", FixedStep="double(Ts)/1000", Solver="FixedStepDiscrete", ProdHWDeviceType="Intel->x86-64 (Linux 64)", SystemTargetFile="sldrt.tlc", TargetLang="C")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
SldrtModelConfig_Tc = Simulink.ConfigSet(StartTime="0", StopTime="10", FixedStep="double(Tc)/1000", Solver="FixedStepDiscrete", ProdHWDeviceType="Intel->x86-64 (Linux 64)", SystemTargetFile="sldrt.tlc", TargetLang="C")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
TO_THOUSAND = Simulink.Parameter(0.001)
TO_HUNDRED = Simulink.Parameter(0.01)
TO_DECADE = Simulink.Parameter(0.1)
TO_DELI = Simulink.Parameter(10)
NumericModelConfig_Ts = Simulink.ConfigSet(StartTime="0", StopTime="inf", FixedStep="double(Ts)/1000", Solver="ode4", ProdHWDeviceType="ARM Compatible->ARM Cortex-M", SystemTargetFile="ert.tlc", TargetLang="C")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

vent_set_param_t = Simulink.Bus()  % 设置参数
  Peep: uint16, Min=0, Max=50, Unit="hPa"  % 呼气末正压设置
  Pinsp: uint16, Min=1, Max=100, Unit="hPa"  % 吸气压力设置
  Psupp: uint16, Min=0, Max=100, Unit="hPa"  % 压力支持水平设置
  Phigh: uint16, Min=1, Max=100, Unit="hPa"  % 高压相压力设置【BiVent,APRV】
  Plow: uint16, Min=0, Max=50, Unit="hPa"  % 低压相压力设置【BiVENT】
  Pcpap: uint16, Min=4, Max=25, Unit="hPa"  % 持续气道正压设置【CPAP】
  Pmax: uint16, Min=2, Max=100, Unit="hPa"  % 最大吸气压力设置【PRVC,SIMV-PRVC】
  Pmin: uint16, Min=1, Max=35, Unit="hPa"  % 最小吸气压力设置【PRVC,SIMV-PRVC】
  Plimit: uint16, Unit="hPa"
  Pmanual: uint16, Unit="hPa"  % nCPRV
  FlowBase: uint16, Unit="L/min"  % 基础流
  FlowHFNC: uint16, Unit="L/min"  % 流量【HFNC】
  Vt: uint16, Min=50, Max=4000, Unit="mL"  % 潮气量设置
  Vtmin: uint16  % 潮气量低报警值
  Vtmax: uint16  % 潮气量高报警值
  MV: uint16  % 分钟通气量
  PercentMinVol: uint16, Min=0, Max=100, Unit="%"  % 最小分钟通气量百分比【ATV】
  Tinsp: uint16, Min=1, Max=120, Unit="ds"  % 吸气时间
  Freq: uint16, Min=4, Max=100, Unit="1/min"  % 机控通气频率
  Tpause: uint16, Min=0, Max=40, Unit="ds"  % 吸气暂停时间
  Tslope: uint16, Min=0, Max=120, Unit="ds"  % 压力上升斜坡时间
  Thigh: uint16, Min=1, Max=300, Unit="ds"  % 高水平压力时间设置【BiVent,APRV】
  Tlow: uint16, Min=1, Max=300, Unit="ds"  % 低水平压力时间设置【BiVent】
  Psens: uint16, Min=0, Max=20, Unit="hPa"  % 自主呼吸压力触发灵敏度设置
  Vsens: uint16, Min=5, Max=200, Unit="dL/min"  % 自主呼吸流速触发灵敏度设置
  Wsens: uint16, Min=0, Max=100, Unit="%"  % 触发窗设置值【麻醉】
  Isens: uint16, Min=5, Max=90, Unit="%"  % 高水平触发灵敏度【APRV】
  Esens: uint16, Min=5, Max=90, Unit="%"  % 切换灵敏度
  TriggerLevel: uint16  % 触发等级【无创呼吸机】
  TriggerType: Enum: trigger_type_t  % 触发类型
  Wave: Enum: vcv_wave_t  % 流量波形种类【VCV】
  Sign: uint16  % 叹息
  FiO2: uint16, Min=21, Max=100, Unit="%"  % 吸入氧浓度设置
  Manual: uint16